# Grasshopper definition algo.gh (Grasshopper 1.0.8)
# plug-ins: RhinoCodePluginGH

waves = Slider(6, range=2..15)
height = Slider(77, range=50..100)
angle = Slider(0.229, range=0..0.4)
rotation = Slider(196, range=0..360)
waves_2 = Slider(9, range=2..15)
height_2 = Slider(61, range=50..100)
angle_2 = Slider(0.131, range=0..0.4)
rotation_2 = Slider(29, range=0..360)
height_3 = Slider(82, range=50..100)
angle_3 = Slider(0.123, range=0..0.4)
rotation_3 = Slider(146, range=0..360)
waves_3 = Slider(5, range=2..15)
# Reload script button
pln = Plane(PlaneXY(-110.5053393, -139.792481, 0))
# toggle first evolution preview
lock_gen_0 = BooleanToggle(False)
pln_2 = Plane(PlaneXY(-110.1039899, 149.7933186, 0))
move_scale = Slider(252, range=0..500)
py3 = Python3Script(x=lock_gen_0)  # -> out
# ---------- py3: Python ----------
import Grasshopper as gh

def toggle_visibility(trigger):
    doc = gh.Instances.ActiveCanvas.Document
    if doc:
        for obj in doc.Objects:
            if obj.NickName == "base_gens_cluster":  # Set your cluster name
                obj.Attributes.Visible = trigger  # Show if trigger is True, hide if False
                obj.Attributes.ExpireLayout()
                obj.ExpireSolution(True)  # Force update

toggle_visibility(x)  # Pass your Boolean trigger
# ---------- end py3 ----------
# Slider Script
py3_2 = Python3Script(x=waves, y=height, z=angle, u=rotation)  # -> out
# ---------- py3_2: Python ----------
# Requirements: clr
import Rhino
import json
import clr

# Add references for .NET namespaces
# needed to convert System.Decimal to float
clr.AddReference("System")
clr.AddReference("System.Globalization")
from System import Decimal
from System.Globalization import CultureInfo

# Initialize an empty dictionary to store data for each slider
sliders_data = {}

# Iterate through all input parameters
for idx, input_param in enumerate(ghenv.Component.Params.Input):
    if input_param.Sources:
        slider = input_param.Sources[0]

        # Convert System.Decimal to Python float using .NET's ToDouble() method
        Min = Decimal.ToDouble(slider.Slider.Minimum)
        Max = Decimal.ToDouble(slider.Slider.Maximum)
        Value = Decimal.ToDouble(slider.Slider.Value)

        precision = slider.Slider.DecimalPlaces
        Step_size = 10 ** -precision
        Range = (Max - Min) / Step_size if Step_size > 0 else 0

        # Store data for this slider in the dictionary
        sliders_data[f"Slider_{idx}"] = {
            "Value": Value,
            "Min": Min,
            "Max": Max,
            "Step Size": Step_size,
            "Range": Range
        }

# Convert the sliders_data dictionary to a JSON string without line breaks
sliders_data_json = json.dumps(sliders_data, separators=(", ", ":"))

# Print the JSON string
print(sliders_data_json)
# ---------- end py3_2 ----------
not = GateNot(A=lock_gen_0)
pln_3 = Plane(PlaneXY(-110.5647147, -0.03284894299, 0))
panel = Panel(py3)
# Bake first evolution
bake_first_evolution = Button()
cluster = Cluster(pln=pln_2, num=waves, relay=height, relay_2=angle, relay_3=rotation)  # -> brep_3, brep_4
# Slider script
py3_3 = Python3Script(x=waves_2, y=height_2, z=angle_2, u=rotation_2)  # -> out; same code as py3_2
cluster_2 = Cluster(pln=pln_3, num=waves_2, relay=height_2, relay_2=angle_2, relay_3=rotation_2)  # -> brep_3, brep_4
layer = ModelLayer(Name="0", DisplayColour=ColourSwatch(SwatchColor=RGB(0, 214, 127)))  # -> Layer, Name, Hidden, Locked, DisplayColour, Material, Linetype
object = ModelObject(Geometry=cluster_2.brep_4, Layer=layer.Layer)  # -> Object, Geometry, Name, Layer, Visibility, Display, Drafting, Render
object_2 = ModelObject(Geometry=cluster.brep_4, Layer=layer.Layer)  # -> Object, Geometry, Name, Layer, Visibility, Display, Drafting, Render
cache = ContentCache(Content=object.Object, Trigger=not, Action=2)
cache_2 = ContentCache(Content=object_2.Object, Trigger=not, Action=2)
panel_2 = Panel("VOTING INPUT")
design_2_voting = Slider(0, range=0..20)
design_3_voting = Slider(20, range=0..20)
design_1_voting = Slider(0, range=0..20)
dup = DuplicateData(Data=py3_2, Number=design_1_voting, Order=True)
dup_2 = DuplicateData(Data=py3_3, Number=design_2_voting, Order=True)
panel_3 = Panel("MUTATION CONFIG")
mutation_probability = Slider(60, range=0..100)
mutation_range = Slider(15, range=0..100)
reload_evolution = Button()
# Slider/File script
py3_4 = Python3Script(x=waves_3, y=height_3, z=angle_3, u=rotation_3, v=pln, s=reload_evolution)  # -> out, evo_num, a, b, c, d
# ---------- py3_4: Python ----------
# Requirements: clr
import Rhino
import json
import clr
import os
import rhinoscriptsyntax as rs

# Add references for .NET namespaces
# needed to convert System.Decimal to float
clr.AddReference("System")
clr.AddReference("System.Globalization")
from System import Decimal
from System.Globalization import CultureInfo

# Initialize an empty dictionary to store data for each slider
sliders_data = {}
child = []


# def add_plane_data():
    # sliders_data[f"Plane"] = {
    #             "Value": Value
    # }

# Iterate through all input parameters
def extract_sliders():
    for idx, input_param in enumerate(ghenv.Component.Params.Input):
        if input_param.Sources:
            slider = input_param.Sources[0]

            if(input_param.Sources[0].Name == "Button"):
                continue

            if(input_param.Sources[0].Name == "out"):
                continue
                

            if(input_param.Sources[0].Name == "Plane"):
                # test = input_param.Sources[0].VolatileData.AllData(True)
                # for v in test:
                #     print(v)
                # print("Booyah")
                continue
            
                # continue 
            # Convert System.Decimal to Python float using .NET's ToDouble() method
            Min = Decimal.ToDouble(slider.Slider.Minimum)
            Max = Decimal.ToDouble(slider.Slider.Maximum)
            Value = Decimal.ToDouble(slider.Slider.Value)

            precision = slider.Slider.DecimalPlaces
            Step_size = 10 ** -precision
            Range = (Max - Min) / Step_size if Step_size > 0 else 0

            # Store data for this slider in the dictionary
            sliders_data[f"Slider_{idx}"] = {
                "Value": Value,
                "Min": Min,
                "Max": Max,
                "Step Size": Step_size,
                "Range": Range
            }

def get_output_directory():
    cwd = rs.WorkingFolder()
    directory = os.path.abspath(os.path.join(cwd, os.pardir))
    directory =  os.path.join(directory, "darwinOutput")
    return directory

def check_directory():
    directory = get_output_directory()
    if ( not os.path.isdir(directory)):
        return False
    return True

def check_evolution_iteration():
    i = 1
    file_exists = False
    directory = get_output_directory()
    while (i < 10):
        filename = os.path.join(directory, "evolution_" + str(i))
        if ( os.path.exists(filename)):
            file_exists = True
        i += 1
    return (file_exists)

def file_exists():
    if (not check_directory()):
        return False
    if (not check_evolution_iteration()):
        return False
    return True

def create_output():
    for i, value in enumerate(child):
        exec(f"{chr(97 + i)} = {value}")

def get_filename():
    i = 1
    file_exists = False
    directory = get_output_directory()
    while (i < 10):
        filename = os.path.join(directory, "evolution_" + str(i))
        if ( not os.path.exists(filename)):
            break;
        prev_filename = filename
        i += 1
    evo_num = prev_filename.split('_', 1)[1]
    # print(evo_num)
    out_name = "evo_num"
    # exec(f"global {out_name}; {out_name} = evo_num")
    globals()['evo_num'] = evo_num
    return (prev_filename)

def extract_file():
    filename = get_filename()
    with open(filename, 'r') as file:
        content = file.read()
        # data = json.loads(content)
        # return data
        return content

def json_file_to_output(file_data):
    data = json.loads(file_data)  # Use json.loads for strings
    for i, (key, slider_data) in enumerate(data.items()):
        value = slider_data["Value"]
        exec(f"global {chr(97 + i)}; {chr(97 + i)} = value")



if (file_exists()):
    sliders_data_json = extract_file()
    json_file_to_output(sliders_data_json)
else:
    extract_sliders()
    create_output() 
    sliders_data_json = json.dumps(sliders_data, separators=(", ", ":"))
    globals()['evo_num'] = 0
    json_file_to_output(sliders_data_json)

# Print the JSON string
print(sliders_data_json)
# ---------- end py3_4 ----------
# dynamic move
cluster_3 = Cluster_2(G=pln, A=py3_4.evo_num, B=move_scale)
# Evo text
cluster_4 = Cluster_3(A=py3_4.evo_num, G=cluster_3)
cluster_5 = Cluster(pln=cluster_3, num=py3_4.a, relay=py3_4.b, relay_2=py3_4.c, relay_3=py3_4.d)  # -> brep_3, brep_4
object_3 = ModelObject(Geometry=cluster_5.brep_4, Layer=layer.Layer)  # -> Object, Geometry, Name, Layer, Visibility, Display, Drafting, Render
cache_3 = ContentCache(Content=object_3.Object, Trigger=not, Action=2)
dup_3 = DuplicateData(Data=py3_4.out, Number=design_3_voting, Order=True)
# Genepool for parents
D = Panel([dup_2, dup_3, dup])
# Random selection on 2 parents from pool
lng = ListLength(List=D)
py3_5 = Python3Script(x=lng)  # -> out
# ---------- py3_5: Python ----------
import random

r = random.randint(0, x)
print(r)
# ---------- end py3_5 ----------
py3_6 = Python3Script(x=lng)  # -> out; same code as py3_5
py3_7 = Python3Script(x=lng)  # -> out; same code as py3_5
py3_8 = Python3Script(x=lng)  # -> out; same code as py3_5
py3_9 = Python3Script(x=lng)  # -> out; same code as py3_5
py3_10 = Python3Script(x=lng)  # -> out; same code as py3_5
item = ListItem(List=D, Index=py3_6, Wrap=True)
item_2 = ListItem(List=D, Index=py3_5, Wrap=True)
item_3 = ListItem(List=D, Index=py3_9, Wrap=True)
item_4 = ListItem(List=D, Index=py3_7, Wrap=True)
item_5 = ListItem(List=D, Index=py3_10, Wrap=True)
item_6 = ListItem(List=D, Index=py3_8, Wrap=True)
panel_4 = Panel(item_2)
# Display of selected parent parameters
panel_5 = Panel(item)
panel_6 = Panel(item_3)
panel_7 = Panel(item_4)
panel_8 = Panel(item_6)
panel_9 = Panel(item_5)
# Evolution Script
py3_11 = Python3Script(parent_1=panel_5, parent_2=panel_4, mutation_probability=mutation_probability, mutation_range=mutation_range)  # -> out, a, b, c, d
# ---------- py3_11: Python ----------
import random
import json


data1 = json.loads(parent_1)
data2 = json.loads(parent_2)

child = []
child_data = {}
num_inputs = len(data1)

# Loop to process each input key dynamically
for i in range(num_inputs):
    key = f"Slider_{i}"
    
    # step_size1 = data1[key]["Step Size"]
    min1 = data1[key]["Min"]
    # print(f"min1:{min1}")
    max1 = data1[key]["Max"]
    # print(f"max1:{max1}")
    step_size1 = data1[key]["Step Size"]
    # print(f"step_size1:{step_size1}")
    range1 = data1[key]["Range"]
    # print(f"range1:{range1}")

    value = data1[key]["Value"] if random.choice([True, False]) else data2[key]["Value"]

    if random.randint(1, 100) < mutation_probability and mutation_range:
        deviation_steps = (range1 / 100) * random.randint(1, mutation_range)
        # print(f"deviation_steps:{deviation_steps}")
        deviation_steps = round(deviation_steps)
        # print(f"deviation_steps_rounded:{deviation_steps}")
        deviation = deviation_steps * step_size1
        # print(f"{value} +- {deviation}")
        value = value + deviation if random.choice([True, False]) else value - deviation
    if value < min1:
        value = min1
    elif value > max1:
        value = max1
    child.append(str(value))
    child_data[f"Slider_{i}"] = {
            "Value": value,
            "Min": min1,
            "Max": max1,
            "Step Size": step_size1,
            "Range": range1
        }


for i, value in enumerate(child):
    exec(f"{chr(97 + i)} = {value}")


# Convert the sliders_data dictionary to a JSON string without line breaks
child_data_json = json.dumps(child_data, separators=(", ", ":"))

# Print the JSON string
print(child_data_json)


# child = ",".join(child)
# print(child)
# ---------- end py3_11 ----------
py3_12 = Python3Script(parent_1=panel_6, parent_2=panel_7, mutation_probability=mutation_probability, mutation_range=mutation_range)  # -> out, a, b, c, d; same code as py3_11
py3_13 = Python3Script(parent_1=panel_9, parent_2=panel_8, mutation_probability=mutation_probability, mutation_range=mutation_range)  # -> out, a, b, c, d; same code as py3_11
bake_evolution = Button()
delete_evolution = Button()
move_scale_2 = Slider(252, range=0..500)
move_scale_3 = Slider(252, range=0..500)
move_scale_4 = Slider(252, range=0..500)
pln_4 = Plane(PlaneXY(139.8496022, -139.9053578, 0))
or = GateOr(A=reload_evolution, B=delete_evolution)
py3_14 = Python3Script(x=or)  # -> out
# ---------- py3_14: Python ----------
import os
import rhinoscriptsyntax as rs

def get_output_directory():
    cwd = rs.WorkingFolder()
    directory = os.path.abspath(os.path.join(cwd, os.pardir))
    directory =  os.path.join(directory, "darwinOutput")
    return directory

def check_directory():
    directory = get_output_directory()
    if ( not os.path.isdir(directory)):
        return (1)

def check_evolution_iteration():
    i = 1
    file_exists = True
    directory = get_output_directory()
    while (file_exists and i < 10):
        filename =  os.path.join(directory, "evolution_" + str(i))
        if ( not os.path.exists(filename)):
            return (i - 1)
        i += 1
    return (11)

if (check_directory()):
    print ("0")
else:
    print(check_evolution_iteration())
# ---------- end py3_14 ----------
py3_15 = Python3Script(x=or)  # -> out; same code as py3_14
py3_16 = Python3Script(x=or)  # -> out; same code as py3_14
pln_5 = Plane(PlaneXY(140.29589, 149.5036736, 0))
pln_6 = Plane(PlaneXY(140.2727861, 0.03294312959, 0))
py3_17 = Python3Script(x=delete_evolution)  # -> out
# ---------- py3_17: Python ----------
import os
import rhinoscriptsyntax as rs
import scriptcontext as sc
import Rhino

# Set script to work with Rhino document instead of GH document
sc.doc = Rhino.RhinoDoc.ActiveDoc  

def get_output_directory():
    cwd = rs.WorkingFolder()
    directory = os.path.abspath(os.path.join(cwd, os.pardir))
    directory = os.path.join(directory, "darwinOutput")
    return directory

def check_evolution_iteration():
    i = 1
    file_exists = True
    directory = get_output_directory()
    while file_exists and i < 10:
        filename = os.path.join(directory, f"evolution_{i}")
        if not os.path.exists(filename):
            filename = os.path.join(directory, f"evolution_{i - 1}")
            file_exists = False
        i += 1
    return filename, i - 1

def delete_file(filename):
    try:
        os.remove(filename)
        print(f"{filename} has been deleted successfully.")
    except FileNotFoundError:
        print(f"{filename} does not exist.")
    except PermissionError:
        print(f"Permission denied: {filename}")
    except Exception as e:
        print(f"Error occurred: {e}")

def delete_layer(layer_name):
    if rs.IsLayer(layer_name):
        obj_ids = rs.ObjectsByLayer(layer_name)
        if obj_ids:
            rs.DeleteObjects(obj_ids)  # Delete all objects on the layer
            print(f"Deleted {len(obj_ids)} objects from layer '{layer_name}'.")
        rs.DeleteLayer(layer_name)
        print("Layer " + layer_name + " deleted!")
    else:
        print("Layer " + layer_name + " does not exist.")
        if layer_name == "1" and rs.IsLayer("0"):
            layer_name = "0"
            obj_ids = rs.ObjectsByLayer(layer_name)
            if obj_ids:
                rs.DeleteObjects(obj_ids)  # Delete all objects on the layer
                print(f"Deleted {len(obj_ids)} objects from layer '{layer_name}'.")
            rs.DeleteLayer(layer_name)
            print("Layer " + layer_name + " deleted!")
            
            


def delete_evolution():
    filename, i = check_evolution_iteration()
    delete_file(filename)
    delete_layer(str(i))
    print("Deleted evolution file and corresponding layer.")

if (x == True):
    delete_evolution()
else:
    print("False")

sc.doc = ghdoc
# ---------- end py3_17 ----------
py3_18 = Python3Script(x=bake_evolution, y=py3_11.out, z=py3_12.out, u=py3_13.out)  # -> out
# ---------- py3_18: Python ----------
import os
import rhinoscriptsyntax as rs

def get_output_directory():
    cwd = rs.WorkingFolder()
    directory = os.path.abspath(os.path.join(cwd, os.pardir))
    directory =  os.path.join(directory, "darwinOutput")
    return directory

def create_directory(directory):
    try:
        os.mkdir(directory)
    except FileExistsError:
        print(f"Directory '{directory}' already exists.")
    except PermissionError:
        print(f"Permission denied: unable to create '{directory}'")
    except Exception as e:
        print(f"An error occurred: {e}")

def check_directory():
    directory = get_output_directory()
    if ( not os.path.isdir(directory)):
        create_directory(directory)

def create_evolution_file(filename):
    f = open(filename, "x")
    f.close()

def check_evolution_iteration():
    i = 1
    file_exists = True
    directory = get_output_directory()
    while (file_exists and i < 10):
        filename =  os.path.join(directory, "evolution_" + str(i))
        if ( not os.path.exists(filename)):
            create_evolution_file(filename)
            file_exists = False
        i += 1
    return (filename)
    

def save_to_file(filename):
    f = open(filename, "w")
    print(y)
    f.write(f"{y}")
    f.close()

def save_evolution():
   filename = check_evolution_iteration()
   save_to_file(filename)
   print("saved")


if (x == True):
   check_directory()
   save_evolution()
else:
   print("False!!!!")
# ---------- end py3_18 ----------
cluster_6 = Cluster_2(G=pln_6, A=py3_14, B=move_scale_3)
cluster_7 = Cluster_2(G=pln_5, A=py3_15, B=move_scale_2)
cluster_8 = Cluster_2(G=pln_4, A=py3_16, B=move_scale_4)
panel_10 = Panel(py3_18)
cluster_9 = Cluster(pln=cluster_8, num=py3_13.a, relay=py3_13.b, relay_2=py3_13.c, relay_3=py3_13.d)  # -> brep_3, brep_4
cluster_10 = Cluster(pln=cluster_6, num=py3_12.a, relay=py3_12.b, relay_2=py3_12.c, relay_3=py3_12.d)  # -> brep_3, brep_4
cluster_11 = Cluster(pln=cluster_7, num=py3_11.a, relay=py3_11.b, relay_2=py3_11.c, relay_3=py3_11.d)  # -> brep_3, brep_4
py3_19 = Python3Script(x=or)  # -> out; same code as py3_14
panel_11 = Panel(py3_19)
layer_2 = ModelLayer(Name=py3_19, DisplayColour=ColourSwatch(SwatchColor=RGB(0, 214, 127)))  # -> Layer, Name, Hidden, Locked, DisplayColour, Material, Linetype
object_4 = ModelObject(Geometry=cluster_11.brep_4, Layer=layer_2.Layer)  # -> Object, Geometry, Name, Layer, Visibility, Display, Drafting, Render
object_5 = ModelObject(Geometry=cluster_10.brep_4, Layer=layer_2.Layer)  # -> Object, Geometry, Name, Layer, Visibility, Display, Drafting, Render
object_6 = ModelObject(Geometry=cluster_9.brep_4, Layer=layer_2.Layer)  # -> Object, Geometry, Name, Layer, Visibility, Display, Drafting, Render
cache_4 = ContentCache(Content=object_4.Object, Trigger=bake_evolution, Action=2)
cache_5 = ContentCache(Content=object_5.Object, Trigger=bake_evolution, Action=2)
cache_6 = ContentCache(Content=object_6.Object, Trigger=bake_evolution, Action=2)

# ==== cluster Cluster
pln = ClusterInput()
pln_2 = Plane(pln)
num = ClusterInput()
num_2 = Number(num)
relay = ClusterInput()
relay_2 = ClusterInput()
relay_3 = ClusterInput()

# ----
# base conture
ground_radius = Panel("30")
ground_inner_radius = Panel("4")
cir = Circle(Plane=pln_2, Radius=ground_radius)
ground_inner_radius_2 = Panel("2")
multiplication = Multiplication(A=ground_inner_radius_2, B=num_2)
divide = DivideCurve(Curve=cir, Count=num_2, Kinks=False)  # -> Points, Tangents, Parameters
pt = Point(divide.Points)

subtraction = Subtraction(A=ground_radius, B=ground_inner_radius)

cir_2 = Circle(Plane=pln_2, Radius=subtraction)
divide_2 = DivideCurve(Curve=cir_2, Count=multiplication, Kinks=False)  # -> Points, Tangents, Parameters
dispatch = Dispatch(List=divide_2.Points, DispatchPattern=[True, False])  # -> ListA, ListB
pt_2 = Point(dispatch.ListB)
weave = Weave(Pattern=[0, 1], Stream0=pt, Stream1=pt_2, NullGaps=False)
pline = PolyLine(Vertices=weave, Closed=invert(False))

# ----
# Model height
ground_inner_radius_3 = Panel("5")
range = Range(Domain=Domain(0, 1), Steps=ground_inner_radius_3)
multiplication_2 = Multiplication(A=range, B=relay)
Z = UnitZ(Factor=multiplication_2)
move = Move(Geometry=pline, Motion=Z)  # -> Geometry, Transform

# ----
# angle
area = Area(Geometry=move.Geometry)  # -> Area, Centroid
lng = ListLength(List=move.Geometry)
series = Series(Start=1, Step=relay_2, Count=lng)
scale = Scale(Geometry=move.Geometry, Center=area.Centroid, Factor=series)  # -> Geometry, Transform

# ----
# Rotation
range_2 = Range(Domain=Domain(0, 1), Steps=ground_inner_radius_3)
multiplication_3 = Multiplication(A=range_2, B=relay_3)
rotate = Rotate(Geometry=scale.Geometry, Angle=degrees(multiplication_3), Plane=pln_2)  # -> Geometry, Transform

loft = Loft(Curves=rotate.Geometry, Options={Adjust=False, Closed=False, LoftEnds=0, LoftSimp=0, LoftType=0, Rebuild=10, Refit=0.01})

# ----
# model for 3D printing
cap = CapHoles(Brep=loft)
brep = Brep(cap)

# ----
# visual model
swatch = ColourSwatch(SwatchColor=RGB(0, 158, 127))
brep_2 = Brep(loft)
preview = CustomPreview(Geometry=brep_2, Material=swatch)

brep_3 = ClusterOutput(brep)
brep_4 = ClusterOutput(brep_2)

# ==== cluster Cluster_2
A = ClusterInput()
B = ClusterInput()
multiplication = Multiplication(A=A, B=B)
vec = VectorXYZ(XComponent=multiplication, YComponent=0, ZComponent=0)  # -> Vector, Length
G = ClusterInput()
move = Move(Geometry=G, Motion=vec.Vector)  # -> Geometry, Transform
G_2 = ClusterOutput(move.Geometry)

# ==== cluster Cluster_3
relative_down = Slider(0, range=-200..200)
relative_left = Slider(-163, range=-500..200)
vec = VectorXYZ(XComponent=relative_left, YComponent=relative_down, ZComponent=0)  # -> Vector, Length
G = ClusterInput()
font_size = Slider(28, range=12..167)
move = Move(Geometry=G, Motion=vec.Vector)  # -> Geometry, Transform
A = ClusterInput()
concat = Concatenate(FragmentA=A, FragmentB=". Gen")
tag = TextTag3D(Location=move.Geometry, Text=concat, Size=font_size, Colour=ColourSwatch(SwatchColor=RGB(0, 0, 0)), Justification=7)
